# Grasshopper definition 19.02.12 Pick and Place.gh (Grasshopper 0.9.76)
# plug-ins: jeneratiff

# ---- group: Geometry Logic / Calibration Points Acquired
acquired_plane = Plane(Plane(origin=(799.0159414, 256.4021291, 414.1020739), x=(-0.03196012674, -0.7137036927, -0.6997182214), y=(-0.1240003695, 0.6974985955, -0.7057758976)))
pick_source = Point(Point(613.0730559, 268.4126021, 0))
place_target = Point(Point(613.0730559, 496.678696, 0))
deconstruct_plane = DeconstructPlane(Plane=acquired_plane)  # -> Origin, XAxis, YAxis, ZAxis

# ---- group: Geometry Logic / Sequencing Logic / Target Locations
number_slider = Slider(3, range=1..10)
vertical_offset = Slider(100, range=0..100)
series = Series(Start=0, Step=vertical_offset, Count=number_slider)
panel = Panel(series)
unit_z = UnitZ(Factor=series)
addition = Addition(A=place_target, B=unit_z)
construct_plane = ConstructPlane(Origin=addition, XAxis=deconstruct_plane.XAxis, YAxis=deconstruct_plane.YAxis)

# ---- group: Geometry Logic / Sequencing Logic / Clearance Point Above Pick Source
vertical_offset_2 = Slider(100, range=0..100)
unit_z_2 = UnitZ(Factor=vertical_offset_2)
addition_2 = Addition(A=pick_source, B=unit_z_2)
construct_plane_2 = ConstructPlane(Origin=addition_2, XAxis=deconstruct_plane.XAxis, YAxis=deconstruct_plane.YAxis)
duplicate_data = DuplicateData(Data=construct_plane_2, Number=number_slider, Order=True)

# ---- group: Geometry Logic / Sequencing Logic / Place Points Above Target
vertical_offset_3 = Slider(100, range=0..100)
unit_z_3 = UnitZ(Factor=vertical_offset_3)
addition_3 = Addition(A=addition, B=unit_z_3)
construct_plane_3 = ConstructPlane(Origin=addition_3, XAxis=deconstruct_plane.XAxis, YAxis=deconstruct_plane.YAxis)

# ---- group: Geometry Logic / Sequencing Logic / Source Points
construct_plane_4 = ConstructPlane(Origin=pick_source, XAxis=deconstruct_plane.XAxis, YAxis=deconstruct_plane.YAxis)
duplicate_data_2 = DuplicateData(Data=construct_plane_4, Number=number_slider, Order=True)

# ---- group: Geometry Logic / Packaging Logic
entwine = Entwine(
    Branch0X=duplicate_data,
    Branch1X=duplicate_data_2,
    Branch2X=duplicate_data,
    Branch3X=construct_plane_3,
    Branch4X=construct_plane,
    Branch5X=construct_plane_3,
    FlattenInputs=False)
panel_4 = Panel(entwine)
flip_matrix = FlipMatrix(Data=entwine)

# ---- group: Robotics / Robotic Motion and Operations Logic / Pick Operations
panel_5 = Panel("DO15")
integer = Integer("1")
robot_task = RobotTask(Robot="1", Connect=0, Control=1, Modify=0, Motion=0, Page=2, Paged=True, Signals=1, Syntax=0)
robot_task_2 = RobotTask(Robot=panel_5, Value=integer, Connect=0, Control=0, Modify=0, Motion=0, Page=1, Paged=True, Signals=1, Syntax=0)

# ---- group: Robotics / Kinematics & Geometric Model Definition
model_robot = ModelRobot(Configuration="IRB1205", Page=0, Paged=False, Range=0)  # -> Robot, Ranges
panel_6 = Panel(model_robot.Robot)

# ---- group: Robotics / Robotic Motion and Operations Logic / Place Operations
robot_task_3 = RobotTask(Robot=panel_5, Connect=0, Control=0, Modify=0, Motion=0, Page=1, Paged=True, Signals=0, Syntax=0)
robot_task_4 = RobotTask(Robot="1", Connect=0, Control=1, Modify=0, Motion=0, Page=2, Paged=True, Signals=1, Syntax=0)
merge = Merge(Data1=robot_task_4, Data2=robot_task_3)

# ---- group: Robotics / Robotic Motion and Operations Logic
pose_settings = PoseSettings(Basis=1, Elbow=1, Page=2, Paged=False, Wrist=0)
merge_2 = Merge(Data1=robot_task_2, Data2=robot_task)
robot_task_5 = RobotTask(
    Robot=model_robot.Robot,
    Joints=flip_matrix,
    Before=pose_settings,
    Before_2=merge_2,
    Every=merge,
    Connect=0,
    Control=0,
    Modify=0,
    Motion=2,
    Page=0,
    Paged=True,
    Signals=0,
    Syntax=0)  # -> flatten(Task)

# ---- group: Representations Layer / Machine Code Compiler
machine_code = MachineCode(Tasks=robot_task_5, Compact=0, Datum=1, Digits=3, Page=3, Paged=False, Type=302)  # -> Code, Report
text_join = TextJoin(Text=machine_code.Code)
panel_8 = Panel(machine_code.Code)

# ---- group: Representations Layer / Live Feedback from Controller
robot_communications = RobotCommunications(Location="192.168.125.1:5515", Interval="500", Page=0, Paged=False, Robot=0)  # -> Joints, Inputs, Outputs, Messages
panel_9 = Panel(robot_communications.Messages)
panel_10 = Panel(robot_communications.Joints)
forward_kinematics = ForwardKinematics(Robot=model_robot.Robot, Joints=robot_communications.Joints)  # -> State, Planes

# ---- group: Representations Layer / Motion Simulation
robot_task_6 = RobotTask(Robot=robot_task_5, Connect=0, Control=0, Modify=1, Motion=0, Page=4, Paged=True, Signals=0, Syntax=0)
display_robot_motion = DisplayRobotMotion(Task=robot_task_6, Major=0, Minor=0)  # -> State, Target

# ---- group: Representations Layer / Program Uploader
file_transfer_request = FileTransferRequest(
    Host="192.168.125.1:21",
    Username="Student",
    Password="123123",
    Location="/Users/Dritsas/jeneratiff.mod",
    Contents=text_join,
    Operation=1,
    Page=1,
    Paged=False,
    Protocol=0)  # disabled
panel_12 = Panel(file_transfer_request)

# ---- group: Representations Layer / Visualization
value_list = ValueList({"Physical": 0, "Virtual": 1}, selected="Virtual")
cluster = Cluster(d1=forward_kinematics.State, d2=display_robot_motion.State, input=value_list)
display_robot_model = DisplayRobotModel(Robot=model_robot.Robot, State=cluster, Display=3, High=56, Low=7, Page=3, Paged=False, Tool=192)

# ==== cluster Cluster
input = ClusterInput()
mass_addition = MassAddition(Input=input)  # -> Result, PartialResults
d2 = ClusterInput()
d1 = ClusterInput()
merge = Merge(Data1=d1, Data2=d2)
list_item = ListItem(List=merge, Index=mass_addition.Result, Wrap=True)
i = ClusterOutput(list_item)
