# Grasshopper definition 19.02.27 Dispense.gh (Grasshopper 0.9.76)
# plug-ins: jeneratiff

# ---- group: Geometric Modeling
number_slider = Slider(200, range=0..200)
number_slider_2 = Slider(56.801, range=0..200)
point = Point(Point(150.602135, 733.3121943, 657.4705361))
plane = Plane(Plane(origin=(142.5240809, 676.4176565, 653.1546691), x=(0.04281866037, -0.007878744743, -0.9990517943), y=(-0.9943664905, -0.09738517672, -0.04184985035)))
unit_z = UnitZ(Factor=number_slider_2)
unit_z_2 = UnitZ(Factor=number_slider_2)
unit_x = UnitX(Factor=number_slider)
unit_y = UnitY(Factor=number_slider)
deconstruct_plane = DeconstructPlane(Plane=plane)  # -> Origin, XAxis, YAxis, ZAxis
addition = Addition(A=point, B=unit_z)
addition_2 = Addition(A=point, B=unit_x)
addition_3 = Addition(A=addition_2, B=unit_z_2)
merge = Merge(Data1=point, Data2=addition_2)
merge_2 = Merge(Data1=addition_2, Data2=addition_3)
merge_3 = Merge(Data1=addition, Data2=point)
construct_plane = ConstructPlane(Origin=merge, XAxis=deconstruct_plane.XAxis, YAxis=deconstruct_plane.YAxis)
construct_plane_2 = ConstructPlane(Origin=merge_3, XAxis=deconstruct_plane.XAxis, YAxis=deconstruct_plane.YAxis)
construct_plane_3 = ConstructPlane(Origin=merge_2, XAxis=deconstruct_plane.XAxis, YAxis=deconstruct_plane.YAxis)

# ---- group: Robot Logic / Kinematics & Geometric Model Definition
model_robot = ModelRobot(Configuration="IRB1205", Page=0, Paged=False, Range=0)  # -> Robot, Ranges
panel = Panel(model_robot.Robot)

# ---- group: Representations Layer / Live Feedback from Controller
robot_communications = RobotCommunications(Location="192.168.125.1:5515", Interval="500", Page=0, Paged=False, Robot=0)  # -> Joints, Inputs, Outputs, Messages
panel_2 = Panel(robot_communications.Messages)
panel_3 = Panel(robot_communications.Joints)
forward_kinematics = ForwardKinematics(Robot=model_robot.Robot, Joints=robot_communications.Joints)  # -> State, Planes

# ---- group: Robot Logic
# StdEnable;
# StdMessage "P200";
# StdMessage "D-1";
# StdMessage "S";
panel_5 = Panel("""var bool Debug := false;

!!-- Disable Robot
!!--
proc StdDisable( )
  !!--  7  6  5  4   3  2  1  0  Bits
  !!-- [0][0][0][0] [0][0][0][0] Disable
  !!--
  SetGO DO_A, 0x00;
endproc  

!!-- Enable Robot
!!--
proc StdEnable( )
  !!--  7  6  5  4   3  2  1  0  Bits
  !!-- [1][0][0][0] [0][0][0][0] Enable Bit    = 0x80
  !!--
  SetGO DO_A, 0x80;
endproc  

!!-- Set Discrete State
!!--
proc StdDiscrete( byte state )
  !!--  7  6  5  4   3  2  1  0  Bits
  !!-- [_][_][_][o] [o][o][o][o] 5-bit State   = 0x00..0x1F
  !!-- [H][_][_][_] [_][_][_][_] Enable Bit    = 0x80
  !!-- [_][_][L][_] [_][_][_][_] Discrete Mode = 0x20 LOW
  !!--
  state := BitOr( BitAnd( state, 0x1F ), 0x80 );
  SetGO DO_A, state;
  TPWrite "Discrete Mode: " + ByteToStr( state \Bin );
endproc

!!-- Set Analog Speed
!!--
proc StdAnalog( byte speed, num direction )
  !!--  7  6  5  4   3  2  1  0  Bits
  !!-- [_][_][_][_] [o][o][o][o] 4-bit Speed     = 0x00..0x0F
  !!-- [_][_][_][o] [_][_][_][_] 1-bit Direction = 0x10
  !!-- [H][_][_][_] [_][_][_][_] Enable Bit      = 0x80
  !!-- [_][_][H][_] [_][_][_][_] Analog Mode     = 0x20 HIGH
  !!-- [H][_][H][_] [_][_][_][_] Enable + Mode   = 0xA0
  !!--
  speed := BitAnd( speed, 0x0F );
    
  if( direction < 0 ) then
    speed := BitOr( speed, 0x10 );
  endif            
  
  speed := BitOr( speed, 0xA0 );
  
  SetGO DO_A, speed;
  
  if( Debug ) then
    TPWrite "Analog Mode: " + ByteToStr( speed \Bin );
  endif
endproc

proc StdMessage( string message )
  
  !!-- Switch Delay
  !!--
  const num delay := 0.07;
  
  !!-- Local Variables
  !!--
  var num index;
  var num count;
  
  !!-- Send Bytes
  !!--
  count := StrLen( message );
  for index from 1 to count do
    StdSendByte StrToByte( StrPart( message, index, 1 ) \Char ), delay;
  endfor
  
  !!-- Send CRLF
  !!--
  StdSendByte 13, delay;
  StdSendByte 10, delay;
  WaitTime delay;

  if( Debug ) then
    TPWrite "Message Mode: " + message;
  endif  
  SetGO DO_A, 0x80;
  WaitTime delay;
endproc

proc StdSendByte( byte value, num delay )
  !!--  7  6  5  4   3  2  1  0  Bits
  !!-- [_][_][_][_] [o][o][o][o] 4-bit Nibble    = 0x00..0x0F
  !!-- [H][_][_][_] [_][_][_][_] Enable Bit      = 0x80
  !!-- [_][H][_][_] [_][_][_][_] Message Flag    = 0x40
  !!-- [_][_][o][_] [_][_][_][_] Clock Flag      = 0x20
  !!-- [_][_][_][o] [_][_][_][_] Reset Flag      = 0x10
  !!-- [H][H][H][_] [_][_][_][_] Send High       = 0xE0
  !!-- [H][H][_][_] [_][_][_][_] Send Low        = 0xC0
  !!--
  
  !!-- Send High Nibble
  !!--
  SetGO DO_A, BitOr( BitAnd( BitRSh( value, 4 ), 0x0F ), 0xE0 );
  WaitTime delay;

  if( Debug ) then
    TPWrite ByteToStr( BitOr( BitAnd( BitRSh( value, 4 ), 0x0F ), 0xE0 ) \Bin );
  endif  
  
  !!-- Send Low Nibble
  !!--
  SetGO DO_A, BitOr( BitAnd( value, 0x0F ), 0xC0 );
  WaitTime delay;    

  if( Debug ) then
    TPWrite ByteToStr( BitOr( BitAnd( value, 0x0F ), 0xC0 ) \Bin );  
  endif  
endproc""")
panel_6 = Panel("""!!-- Speed, Direction
!!-- 0..15, +1/-1
StdEnable;
StdAnalog 3, 1;""")
panel_7 = Panel("""!!-- State 0..31
!!--
StdEnable;
StdDiscrete 1;""")
pose_settings = PoseSettings(Basis=1, Elbow=1, Page=2, Paged=False, Wrist=0)
robot_task = RobotTask(Robot=panel_7, Connect=0, Control=0, Modify=0, Motion=0, Page=3, Paged=True, Signals=0, Syntax=3)
robot_task_2 = RobotTask(Robot="StdDisable;", Connect=0, Control=0, Modify=0, Motion=0, Page=3, Paged=True, Signals=0, Syntax=3)

# ---- group: Robot Logic / Global Variables and Functions
robot_task_3 = RobotTask(Robot=panel_5, Connect=0, Control=0, Modify=0, Motion=0, Page=3, Paged=True, Signals=0, Syntax=2)

# ---- group: Robot Logic / Printing
robot_task_4 = RobotTask(
    Robot=model_robot.Robot,
    Joints=construct_plane,
    Before=pose_settings,
    Before_2=robot_task,
    Every=robot_task_2,
    Connect=0,
    Control=0,
    Modify=0,
    Motion=2,
    Page=0,
    Paged=True,
    Signals=0,
    Syntax=0)

# ---- group: Robot Logic / Approach
robot_task_5 = RobotTask(
    Robot=model_robot.Robot,
    Joints=construct_plane_2,
    Before=pose_settings,
    Before_2=robot_task_3,
    Connect=0,
    Control=0,
    Modify=0,
    Motion=2,
    Page=0,
    Paged=True,
    Signals=0,
    Syntax=0)

# ---- group: Robot Logic / Retraction
robot_task_6 = RobotTask(
    Robot=model_robot.Robot,
    Joints=construct_plane_3,
    Before=pose_settings,
    Connect=0,
    Control=0,
    Modify=0,
    Motion=2,
    Page=0,
    Paged=True,
    Signals=0,
    Syntax=0)

# ---- group: Robot Logic (continued)
merge_4 = Merge(Data1=robot_task_5, Data2=robot_task_4, Data3=robot_task_6)

# ---- group: Representations Layer / Machine Code Compiler
machine_code = MachineCode(Tasks=merge_4, Compact=1, Datum=1, Digits=3, Page=3, Paged=False, Type=302)  # -> Code, Report
text_join = TextJoin(Text=machine_code.Code)
panel_9 = Panel(machine_code.Code)

# ---- group: Representations Layer / Motion Simulation
robot_task_7 = RobotTask(Robot=merge_4, Connect=0, Control=0, Modify=1, Motion=0, Page=4, Paged=True, Signals=0, Syntax=0)
display_robot_motion = DisplayRobotMotion(Task=robot_task_7, Major=0, Minor=0)  # -> State, Target

# ---- group: Representations Layer / Program Uploader
file_transfer_request = FileTransferRequest(
    Host="192.168.125.1:21",
    Username="Student",
    Password="123123",
    Location="/Users/Dritsas/jeneratiff.mod",
    Contents=text_join,
    Operation=1,
    Page=1,
    Paged=False,
    Protocol=0)  # disabled
panel_10 = Panel(file_transfer_request)

# ---- group: Representations Layer / Visualization
value_list = ValueList({"Physical": 0, "Virtual": 1}, selected="Physical")
cluster = Cluster(d1=forward_kinematics.State, d2=display_robot_motion.State, input=value_list)
display_robot_model = DisplayRobotModel(Robot=model_robot.Robot, State=cluster, Display=3, High=56, Low=7, Page=3, Paged=False, Tool=192)

# ==== cluster Cluster
input = ClusterInput()
mass_addition = MassAddition(Input=input)  # -> Result, PartialResults
d2 = ClusterInput()
d1 = ClusterInput()
merge = Merge(Data1=d1, Data2=d2)
list_item = ListItem(List=merge, Index=mass_addition.Result, Wrap=True)
i = ClusterOutput(list_item)
